# Grasshopper definition FloorPlanGenerator_Combined.gh (Grasshopper 1.0.7)
# plug-ins: Wombat

defaultvalue = Panel("Polygon")
defaultvalue_2 = Panel("aingle loaded")
corridorwidth_m = Slider(2.5, range=0..2.5)
buildingdepth_m = Slider(25, range=0..100)
randomreduceby = Slider(5, range=0..10)
floorheight = Slider(4, range=2.2..4)

# ---- group: RH_IN:lineType
txt = Text(defaultvalue)

# ---- group: RH_IN:corridor
data = Data(defaultvalue_2)

# ----
# Linear or Courtyard
# (LineString or Polygon)
panel = Panel("Polygon")
tmatch = MatchText(Text=txt, RegEx=panel, Case=True)
filter = StreamFilter(Gate=tmatch, Stream0="0", Stream1="1")
typology = Number(filter)

# ----
# Single or Double Corridor
panel_2 = Panel("double loaded")
tmatch_2 = MatchText(Text=data, RegEx=panel_2, Case=True)
filter_2 = StreamFilter(Gate=tmatch_2, Stream0="0", Stream1="1")
corridor = Number(filter_2)

writepythonfiles = Text("False")

# ----
# Levels
# (European)
defaultvalue_3 = Panel("8")
alternativepts = Data(Tree({0;0;0}: [-12.08129629, 78.75215361], {0;0;1}: [-64.43358023, -3.132187928], {0;0;2}: [-21.47786008, -50.56246226], {0;0;3}: [-3.579643346, -52.35228393], {0;0;4}: [53.24719477, 1.342366255], {0;0;5}: [48.32518517, 25.95241426]))
defaultpts = Data(Tree({0;0;0}: [-43.78647637, 36.29287099], {0;0;1}: [79.60457781, 45.09542952], {0;0;2}: [40.42267925, -46.10201195], {0;0;3}: [-76.24078068, -37.29945342]))
buildingdepth_m_2 = Number(buildingdepth_m)
corridorwidth_m_2 = Number(corridorwidth_m)
randcombinerooms = Number(randomreduceby)
floor_height = Number(floorheight)

# ---- group: RH_IN:levels
data_2 = Data(defaultvalue_3)

# ---- group: RH_IN:vertices
data_3 = Data(alternativepts)

# ----
levels = Number(data_2)
division = Division(A=buildingdepth_m_2, B=2)
division_2 = Division(A=corridorwidth_m_2, B=2)

flip = FlipMatrix(Data=data_3)
bang = ExplodeTree(Data=flip)  # -> Branch0, Branch1
pt = ConstructPoint(XCoordinate=bang.Branch0, YCoordinate=bang.Branch1, ZCoordinate=0)

_0_5_buildingdepth_m = Number(division)
_0_5corridordepth_m = Number(division_2)
typology_2 = Number(filter)
pline = PolyLine(Vertices=pt, Closed=typology_2)
_0_5_corridordepth_m = Number(_0_5corridordepth_m)
neg = Negative(Value=_0_5_corridordepth_m)
offset = OffsetCurve(Curve=pline, Distance=[_0_5_corridordepth_m, neg], Corners=1)  # -> flatten(Curve)
centerline = Geometry(pline)
item = ListItem(List=offset, Index=0, Wrap=True)  # -> Item, Item1
_0_5_buildingdepth_m_2 = Number(_0_5_buildingdepth_m)
neg_2 = Negative(Value=_0_5_buildingdepth_m_2)
offset_2 = OffsetCurve(Curve=item.Item1, Distance=neg_2, Corners=1)  # -> flatten(Curve)
offset_3 = OffsetCurve(Curve=item.Item, Distance=_0_5_buildingdepth_m_2, Corners=1)  # -> flatten(Curve)
corridor_2 = Number(corridor)

# ----
# buildingSrfMinusCorridor
loft = Loft(
    Curves=[offset_3, item.Item],
    Options={Adjust=False, Closed=False, LoftEnds=0, LoftSimp=0, LoftType=0, Rebuild=10, Refit=0.01})
loft_2 = Loft(
    Curves=[offset_2, item.Item1],
    Options={Adjust=False, Closed=False, LoftEnds=0, LoftSimp=0, LoftType=0, Rebuild=10, Refit=0.01})
boundary = BoundarySurfaces(Edges=[item.Item, offset_3])
boundary_2 = BoundarySurfaces(Edges=[item.Item1, offset_2])
filter_3 = StreamFilter(Gate=corridor_2, Stream0=loft, Stream1=[loft_2, loft])
filter_4 = StreamFilter(Gate=corridor_2, Stream0=boundary, Stream1=[boundary, boundary_2])
typology_3 = Number(filter)
filter_5 = StreamFilter(Gate=typology_3, Stream0=filter_3, Stream1=filter_4)

corridor_3 = Number(corridor)

# ----
# buildingOutlineCrv
merge = Merge(Data1=offset_3, Data2=item.Item1)
merge_2 = Merge(Data1=offset_3, Data2=offset_2)
filter_6 = StreamFilter(Gate=corridor_3, Stream0=merge, Stream1=merge_2)

# ----
# cutCrvs
panel_3 = Panel("5")
divdist = DivideDistance(Curve=centerline, Distance=panel_3)  # -> Points, Tangents, Parameters
panel_4 = Panel("""0
-1""")
cull_i = CullIndex(List=divdist.Points, Indices=panel_4, Wrap=True)
pull = PullPoint(Point=cull_i, Geometry=graft(filter_6), ClosestOnly=True)  # -> ClosestPoint, Distance
ln = Line(StartPoint=cull_i, EndPoint=pull.ClosestPoint)

# ----
# corridorSrf
loft_3 = Loft(Curves=offset, Options={Adjust=False, Closed=False, LoftEnds=0, LoftSimp=0, LoftType=0, Rebuild=10, Refit=0.01})
boundary_3 = BoundarySurfaces(Edges=offset)
typology_4 = Number(filter)
filter_7 = StreamFilter(Gate=typology_4, Stream0=loft_3, Stream1=boundary_3)

typology_5 = Number(filter)

# ----
# Random Reduce
# Make Larger Rooms
linearrandreduce = Slider(32, range=0..100)
courtyardrandreduce = Slider(5, range=0..10)
division_3 = Division(A=linearrandreduce, B="2")
split = SplitWithBrep(Curve=simplify(ln), Brep=filter_7)  # -> Curve, Points
filter_8 = StreamFilter(Gate=typology_5, Stream0=division_3, Stream1=courtyardrandreduce)
item_2 = ListItem(List=split.Curve, Index="1", Wrap=True)
reduce = RandomReduce(List=flatten(item_2), Reduction=filter_8, Seed=1)

# ----
# Clean Up Corners
end = EndPoints(Curve=reduce)  # -> Start, End
cullpt = CullDuplicates(Points=end.End, Tolerance=0.1, CullMode=3)  # -> Points, Indices, Valence
item_3 = ListItem(List=reduce, Index=cullpt.Indices, Wrap=True)

# ----
# demisingCrvs
building_boundary_srf = Surface(filter_5)

# ---- group: Corridor Curves
crv = Curve(flatten(offset))

# ---- group: Demising
crv_2 = Curve(item_3)

# ----
merge_3 = Merge(Data1=crv_2, Data2=crv)  # -> flatten(Result)

# ----
# Sort out Corridor
midpt = CurveMiddle(Curve=centerline)
srfsplit = SurfaceSplit(Surface=building_boundary_srf, Curves=merge_3)
srf_cp = SurfaceClosestPoint(Point=midpt, Surface=srfsplit)  # -> Point, UVPoint, Distance
smaller = SmallerThan(FirstNumber=srf_cp.Distance, SecondNumber="1e-5")  # -> SmallerThan, OrEqualTo
dispatch = Dispatch(List=srfsplit, DispatchPattern=smaller.SmallerThan)  # -> ListA, ListB

# ----
# Sort Surfaces Along Corridor Center Curve
area = Area(Geometry=dispatch.ListB)  # -> Area, Centroid
pull_2 = PullPoint(Point=area.Centroid, Geometry=centerline, ClosestOnly=True)  # -> ClosestPoint, Distance
# corridorNodes
alongcrv = SortAlongCurve(Points=pull_2.ClosestPoint, Curve=centerline)  # -> Points, Indices
mindex = MemberIndex(Set=pull_2.ClosestPoint, Member=alongcrv.Points)  # -> Index, Count
cset = CreateSet(List=flatten(mindex.Index))  # -> Set, Map
item_4 = ListItem(List=dispatch.ListB, Index=cset.Set, Wrap=True)

corridor_nodes = Point(alongcrv.Points)

len = Length(Curve=centerline)
division_4 = Division(A=len, B="120")
round = Round(Number=division_4)  # -> Nearest, Floor, Ceiling
divide = DivideCurve(Curve=centerline, Count=round.Ceiling, Kinks=False)  # -> Points, Tangents, Parameters

# ----
# Find Room Closest to Egress Points
geo = Geometry(item_4)
area_2 = Area(Geometry=geo)  # -> Area, Centroid
dist = Distance(PointA=area_2.Centroid, PointB=graft(divide.Points))
sort = SortList(Keys=dist, ValuesA=geo)  # -> Keys, ValuesA
cull_i_2 = CullIndex(List=sort.ValuesA, Indices="0", Wrap=True)  # -> flatten(List)

# ---- group: Egress
item_5 = ListItem(List=sort.ValuesA, Index=0, Wrap=True)  # -> flatten(Item)

# ----
corridor_4 = Number(corridor)
area_3 = Area(Geometry=cull_i_2)  # -> Area, Centroid

# ---- group: Egress Nodes
area_4 = Area(Geometry=item_5)  # -> Area, Centroid

# ----
# egressNodes
floorheight_2 = Slider(4, range=0..10)
typology_6 = Number(typology)

cset_2 = CreateSet(List=area_3.Centroid)  # -> Set, Map
mindex_2 = MemberIndex(Set=cset_2.Set, Member=area_4.Centroid)  # -> Index, Count

levels_2 = Number(levels)
series = Series(Start=floorheight_2, Step=floorheight_2, Count=levels_2)  # -> flatten(Series)

# ---- group: roomNodes
cull_i_3 = CullIndex(List=cset_2.Set, Indices=flatten(mindex_2.Index), Wrap=True)

# ----
unit_z = UnitZ(Factor=series)  # -> simplify(graft(UnitVector))

cp = ClosestPoint(Point=cull_i_3, Cloud=flatten(corridor_nodes))  # -> ClosestPoint, CPIndex, Distance

# ---- group: Rooms Egdes
# roomEdges
line = Line(StartPoint=cull_i_3, EndPoint=cp.ClosestPoint)

# ---- group: Egress nodes
move = Move(Geometry=flatten(item_5), Motion=unit_z)  # -> Geometry, Transform
data_4 = Data([item_5, move.Geometry])
area_5 = Area(Geometry=data_4)  # -> Area, Centroid

# ----
data_5 = Data(flatten(line))
negative = Negative(Value=floorheight_2)

# ---- group: Room Nodes
move_2 = Move(Geometry=flatten(cull_i_3), Motion=unit_z)  # -> Geometry, Transform

# ---- group: Room Edges
move_3 = Move(Geometry=flatten(data_5), Motion=unit_z)  # -> Geometry, Transform

# ---- group: egressNodes
area_6 = Area(Geometry=move.Geometry)  # -> Area, Centroid

# ----
roomedges = Data([data_5, move_3.Geometry])

# ---- group: verticalEgress
line_sdl = LineSDL(Start=area_6.Centroid, Direction=Vector(0, 0, 1), Length=negative)

# ----
removedupcrv = RemoveDupCrv(relay=line_sdl)
removedupcrv_2 = RemoveDupCrv(relay=roomedges)

# ---- group: Corridor edges
# Corridor Edges
explode = Explode(Curve=centerline, Recursive=True)  # -> Segments, Vertices
cull_duplicates = CullDuplicates(Points=corridor_nodes, Tolerance=0.1, CullMode=3)  # -> flatten(Points), Indices, Valence
cull_duplicates_2 = CullDuplicates(Points=corridor_nodes, Tolerance=0.1, CullMode=3)  # -> Points, Indices, Valence
point = Point([explode.Vertices, cull_duplicates_2.Points])
curve_closest_point = CurveClosestPoint(Point=flatten(point), Curve=centerline)  # -> Point, Parameter, Distance
shatter = Shatter(Curve=centerline, Parameters=curve_closest_point.Parameter)
end_points = EndPoints(Curve=shatter)  # -> Start, End
point_2 = Point([end_points.Start, end_points.End])
cull_duplicates_3 = CullDuplicates(Points=point_2, Tolerance=0.1, CullMode=3)  # -> Points, Indices, Valence
filter_9 = StreamFilter(Gate=corridor_4, Stream0=cull_duplicates.Points, Stream1=cull_duplicates_3.Points)

# ---- group: Corridor edges / corridor Nodes
data_6 = Data(flatten(filter_9))

# ----
cp_2 = ClosestPoint(Point=area_4.Centroid, Cloud=flatten(data_6))  # -> ClosestPoint, CPIndex, Distance
pt_2 = Point(cp_2.ClosestPoint)
line_2 = Line(StartPoint=area_4.Centroid, EndPoint=cp_2.ClosestPoint)
point_list = PointList(Points=pt_2)
pt_3 = Point(area_4.Centroid)
# egressNodes
move_4 = Move(Geometry=flatten(pt_3), Motion=unit_z)  # -> Geometry, Transform
move_5 = Move(Geometry=flatten(line_2), Motion=unit_z)  # -> Geometry, Transform
merge_4 = Merge(Data1=flatten(pt_3), Data2=flatten(move_4.Geometry))
merge_5 = Merge(Data1=flatten(line_2), Data2=flatten(move_5.Geometry))
lng = ListLength(List=pt_3)
lng_2 = ListLength(List=line_2)

# ---- group: Corridor nodes
move_6 = Move(Geometry=flatten(data_6), Motion=unit_z)  # -> Geometry, Transform

# ---- group: Egress Nodes Per Level
partition = PartitionList(List=merge_4, Size=lng)  # -> simplify(Chunks)

# ---- group: Egress Edges Per Level
partition_2 = PartitionList(List=merge_5, Size=lng_2)  # -> simplify(Chunks)

# ----
removedupcrv_3 = RemoveDupCrv(relay=partition_2)
# removeDup
cullpt_2 = CullDuplicates(Points=partition, Tolerance=0.1, CullMode=3)  # -> Points, Indices, Valence
allegressedges = Curve(flatten([removedupcrv, removedupcrv_3]))
list_length = ListLength(List=flatten(cullpt_2.Points))

# ---- group: Egress Edge Weights
len_2 = Length(Curve=flatten(allegressedges))

# ---- group: Corridor edges (continued)
shift_list = ShiftList(List=data_6, Shift=1, Wrap=True)
cull_index = CullIndex(List=shift_list, Indices="-1", Wrap=True)
dispatch_2 = Dispatch(List=data_6, DispatchPattern=[True, False])  # -> ListA, ListB
line_3 = Line(StartPoint=dispatch_2.ListA, EndPoint=dispatch_2.ListB)

# ----
filter_10 = StreamFilter(Gate=typology_6, Stream0=cull_index, Stream1=shift_list)

# ---- group: Corridor edges (continued)
dispatch_3 = Dispatch(List=filter_10, DispatchPattern=[True, False])  # -> ListA, ListB
# roomNodes
line_4 = Line(StartPoint=dispatch_3.ListA, EndPoint=dispatch_3.ListB)
weave = Weave(Pattern=[0, 1], Stream0=line_3, Stream1=line_4, NullGaps=False)

# ----
# corridorEdges
corridoredges = Curve(weave)

# ---- group: Corridor Edges
move_7 = Move(Geometry=flatten(corridoredges), Motion=unit_z)  # -> Geometry, Transform

# ----
corridoredges_2 = Data([move_7.Geometry, corridoredges])

merge_6 = Merge(Data1=flatten(corridoredges), Data2=flatten(move_7.Geometry))
merge_7 = Merge(Data1=cull_i_3, Data2=flatten(move_2.Geometry))
merge_8 = Merge(Data1=data_6, Data2=flatten(move_6.Geometry))
merge_9 = Merge(Data1=data_5, Data2=flatten(move_3.Geometry))
lng_3 = ListLength(List=corridoredges)
lng_4 = ListLength(List=data_5)
lng_5 = ListLength(List=cull_i_3)
lng_6 = ListLength(List=data_6)

# ---- group: Corridor Edges Per Level
partition_3 = PartitionList(List=merge_6, Size=lng_3)  # -> simplify(Chunks)

# ---- group: Room Nodes Per Level
partition_4 = PartitionList(List=merge_7, Size=lng_5)

# ---- group: Room Edges Per Level
partition_5 = PartitionList(List=merge_9, Size=lng_4)

# ---- group: Corridor Nodes Per Level
partition_6 = PartitionList(List=merge_8, Size=lng_6)

# ----
removedupcrv_4 = RemoveDupCrv(relay=partition_3)
removedupcrv_5 = RemoveDupCrv(relay=corridoredges_2)
cullpt_3 = CullDuplicates(Points=partition_6, Tolerance=0.1, CullMode=3)  # -> Points, Indices, Valence
cullpt_4 = CullDuplicates(Points=partition_4, Tolerance=0.1, CullMode=3)  # -> Points, Indices, Valence

# ---- group: Corridor Weight
length = Length(Curve=removedupcrv_4)

# ----
alledges = Data([removedupcrv_5, removedupcrv_2, removedupcrv, removedupcrv_3])
list_length_2 = ListLength(List=flatten(cullpt_4.Points))
list_length_3 = ListLength(List=flatten(cullpt_3.Points))
merge_10 = Merge(Data1=flatten(cullpt_4.Points), Data2=flatten(cullpt_2.Points), Data3=flatten(cullpt_3.Points))
item_index = ItemIndex(List=merge_10, Item=merge_10)
point_list_2 = PointList(Points=merge_10)
deconstruct = Deconstruct(Point=merge_10)  # -> XComponent, YComponent, ZComponent
collision_one_many = CollisionOneMany(Collider=flatten(alledges), Obstacles=graft(merge_10))  # -> Collision, Index

# ---- group: LIST LENGTH FOR EACH EDGE CATEGORY
merge_11 = Merge(Data1=list_length_2, Data2=list_length, Data3=list_length_3)

# ----
mass_addition = MassAddition(Input=collision_one_many.Collision)  # -> flatten(Result), PartialResults

# ---- group: Room Nodes
point_3 = Point(flatten(cullpt_4.Points))

# ---- group: Corridor Nodes
point_4 = Point(flatten(cullpt_3.Points))

# ---- group: Corridor Weight
num = Number(flatten(length))

# ----
# Nodes
# CSV Output
# Edges
panel_5 = Panel("CORRIDOR")  # disabled
panel_6 = Panel("EGRESS")  # disabled
panel_7 = Panel("UNIT")  # disabled
duplicate_data = DuplicateData(Data=panel_7, Number=list_length_2, Order=True)  # disabled
duplicate_data_2 = DuplicateData(Data=panel_6, Number=list_length, Order=True)  # disabled
duplicate_data_3 = DuplicateData(Data=panel_5, Number=list_length_3, Order=True)  # disabled
panel_8 = Panel("{0:0000}")  # disabled
seed = Number()  # disabled
format = Format(Format=panel_8, Culture=127, Data0=seed)  # disabled
path = FilePath("D:\IAAC\04_Thesis\002_Model\csv\")  # disabled
panel_9 = Panel(".csv")  # disabled
panel_10 = Panel("T01Nodes")  # disabled
panel_11 = Panel("T01Edges")  # disabled
concat = Concatenate(FragmentA=path, FragmentB=panel_10, FragmentC=format, FragmentD=panel_9)  # disabled
concat_2 = Concatenate(FragmentA=path, FragmentB=panel_11, FragmentC=format, FragmentD=panel_9)  # disabled
panel_12 = Panel(concat_2)  # disabled
boolean_toggle = Text(writepythonfiles)
boolean_toggle_2 = Text(writepythonfiles)

# ---- group: Node Names / Labels
merge_12 = Merge(Data1=duplicate_data, Data2=duplicate_data_2, Data3=duplicate_data_3)  # disabled

# ----
partition_7 = PartitionList(List=item_index, Size=merge_11)
bang_2 = ExplodeTree(Data=simplify(partition_7))  # -> Branch0, Branch1, Branch2
cp_3 = ClosestPoint(Point=point_3, Cloud=point_4)  # -> ClosestPoint, CPIndex, Distance
ln_2 = Line(StartPoint=point_3, EndPoint=cp_3.ClosestPoint)

# ---- group: Room Node ID
data_7 = Data(bang_2.Branch0)

# ---- group: Corridor Node ID
data_8 = Data(bang_2.Branch2)

# ----
item_6 = ListItem(List=data_8, Index=cp_3.CPIndex, Wrap=True)  # disabled

merge_13 = Merge(Data1=flatten(ln_2), Data2=flatten(allegressedges), Data3=flatten(removedupcrv_4))
end_2 = EndPoints(Curve=merge_13)  # -> Start, End
entwine = Entwine(Branch00=end_2.Start, Branch01=end_2.End, FlattenInputs=True)
flip_2 = FlipMatrix(Data=entwine)  # -> simplify(Data)
pdecon = Deconstruct(Point=flip_2)  # -> XComponent, YComponent, ZComponent
pdecon_2 = Deconstruct(Point=merge_10)  # -> XComponent, YComponent, ZComponent
python = GhPythonScript(
    vx=pdecon.XComponent,
    vy=pdecon.YComponent,
    vz=pdecon.ZComponent,
    x=pdecon_2.XComponent,
    y=pdecon_2.YComponent,
    z=pdecon_2.ZComponent)  # -> out, simplify(edge_verticies); inputs vx: tree, vy: tree, vz: tree, x: list, y: list, z: list
# ---------- python: Python ----------
import rhinoscriptsyntax as rs
import Rhino.Geometry as rg
import ghpythonlib.treehelpers as th
import Rhino.RhinoMath as rm

vx=th.tree_to_list(vx,None)
vy=th.tree_to_list(vy,None)
vz=th.tree_to_list(vz,None)

epsilon=0.0000000001
edge_verticies=[]
for i in range(len(vx)):
    for j in range(len(x)):
        if rm.EpsilonEquals(vx[i][0],x[j],epsilon) and rm.EpsilonEquals(vy[i][0],y[j],epsilon) and rm.EpsilonEquals(vz[i][0],z[j],epsilon):
            first_node=j
        else:
            pass
        if rm.EpsilonEquals(vx[i][1],x[j],epsilon) and rm.EpsilonEquals(vy[i][1],y[j],epsilon) and rm.EpsilonEquals(vz[i][1],z[j],epsilon):
            second_node=j
        else:
            pass
    edge_verticies.append([first_node,second_node])
    
edge_verticies=th.list_to_tree(edge_verticies)
# ---------- end python ----------
panel_13 = Panel(pdecon.YComponent)

# ---- group: Room To Corridor Edge Length / Weight
len_3 = Length(Curve=ln_2)

# ---- group: Weights
merge_14 = Merge(Data1=flatten(len_3), Data2=flatten(len_2), Data3=flatten(num))  # -> simplify(graft(Result))

# ----
merge_15 = Merge(Data1=simplify(graft(item_index)), Data2=simplify(graft(merge_12)), Data3=simplify(graft(mass_addition.Result)))  # disabled
python_2 = GhPythonScript(write=boolean_toggle_2, v=python.edge_verticies, path=concat_2, features_1=flatten(merge_14))  # -> out, a; inputs write: Boolean, v: tree of Int32, features_1: list; disabled
# ---------- python_2: Python ----------
import rhinoscriptsyntax as rs
import Rhino.Geometry as rg
import csv
import ghpythonlib.treehelpers as th

v=th.tree_to_list(v,None)

if write:
    with open(path, 'wb') as file:
        writer = csv.writer(file)
        writer.writerow(['vi','vj','feature_1'])
        for i in range(len(v)):
           writer.writerow([v[i][0], v[i][1], features_1[i]])
        file.close
# ---------- end python_2 ----------
python_3 = GhPythonScript(
    write=boolean_toggle,
    x=deconstruct.XComponent,
    y=deconstruct.YComponent,
    z=deconstruct.ZComponent,
    path=concat,
    features=merge_15)  # -> out, a; inputs write: Boolean, x: list, y: list, z: list, features: tree; disabled
# ---------- python_3: Python ----------
import rhinoscriptsyntax as rs
import Rhino.Geometry as rg
import csv
import ghpythonlib.treehelpers as th

if write:
    features=th.tree_to_list(features,None)
    
    with open(path, 'wb') as file:
        writer = csv.writer(file)
        writer.writerow(['x','y','z','id','label','degree'])
        for i in range(len(x)):
           writer.writerow([x[i], y[i], z[i], features[i][0],features[i][1],features[i][2]])
        file.close
# ---------- end python_3 ----------

lng_7 = ListLength(List=len_2)
lng_8 = ListLength(List=merge_14)

# ----
# OUTPUT
python_4 = GhPythonScript(
    x=flatten(deconstruct.XComponent),
    y=flatten(deconstruct.YComponent),
    z=flatten(deconstruct.ZComponent),
    nodeDegree=flatten(mass_addition.Result),
    v=python.edge_verticies,
    edgeFeatures=flatten(merge_14))  # -> out, output, flatten(json_string); inputs x: list, y: list, z: list, nodeDegree: list, v: tree, edgeFeatures: list
# ---------- python_4: Python ----------
__author__ = "REN"
__version__ = "2023.08.19"

import rhinoscriptsyntax as rs
import ghpythonlib.treehelpers as th
import json

data_dict = {}
edge_dict = {}
node_dict = {}
edge_array = []
node_array = []

#if not isinstance(v, list):  # replace type_expected_for_tree with the expected type
#    print("v is not a tree!")
#else:
v = th.tree_to_list(v, None)
# edgeFeatures = th.tree_to_list(edgeFeatures, None)
c = 0

for i in range(len(v)):
    edge_dict = {
        "edge": {
            "type": "object",
            "additionalProperties": False,
            "properties": {
                "id": c,
                "source": v[i][0],
                "target": v[i][1],
                "metadata": {
                    "length": edgeFeatures[i]
                }
            }
        }
    }
    edge_array.append(edge_dict)
    c+=1

c = 0
for i in range(len(x)):
    node_dict = {
        "node": {
            "type": "object",
            "properties": {
                "label": c,
                "degree": nodeDegree[i],
                "metadata": {
                    "type": "Feature",
                    "geometry": {
                        "type": "Point",
                        "coordinates": [x[i], y[i], z[i]]
                    }
                }
            }
        }
    }
    node_array.append(node_dict)
    c+=1

data_dict = {"title": "Graph Start",
"type": "FeatureCollection",
"features": node_array + edge_array
}
data_str = str(data_dict)
data_clean = data_str.replace("'", '"')

output = data_clean
json_string = json.dumps(data_dict)
# ---------- end python_4 ----------

# ----
# manualOutput.JSON
toggle = BooleanToggle(False)
path_2 = FilePath("D:\IAAC\04_Thesis\git-calculatorapp-frontend\backendJames\assets\manualOutput.JSON")
writetxt = WriteToTextFile(Run=toggle, TextToWrite=python_4.json_string, FilePath=path_2, Append=False, NewOnly=False)

# ---- group: RH_OUT:output
data_9 = Data(python_4.output)

# ==== cluster RemoveDupCrv
relay = ClusterInput()
midpt = CurveMiddle(Curve=relay)
cullpt = CullDuplicates(Points=midpt, Tolerance=0.1, CullMode=3)  # -> Points, Indices, Valence
item = ListItem(List=relay, Index=cullpt.Indices, Wrap=True)
end = EndPoints(Curve=item)  # -> Start, End
ln = Line(StartPoint=end.Start, EndPoint=end.End)
L = ClusterOutput(ln)
